# Grasshopper definition flujo-grasshopper.ghx (Grasshopper 1.0.8)

path = FilePath("C:\Users\nicol\Downloads\TEMP MIN Y HUM MAX (1).csv")
file = ReadFile(File=path, PerLineParse=True)
item = ListItem(List=file, Index=Slider(3, range=1..13), Wrap=True)
panel = Panel(file)
panel_2 = Panel(item)
rep = ReplaceText(Text=panel_2, Find="\"", RecursiveReplace=False)
panel_3 = Panel(rep)
split = TextSplit(Text=panel_3, Separators=",")
panel_4 = Panel(split)
item_2 = ListItem(List=panel_4, Index=Slider(1, range=0..10), Wrap=True)
item_3 = ListItem(List=panel_4, Index=Slider(0, range=0..10), Wrap=True)
item_4 = ListItem(List=panel_4, Index=Slider(3, range=0..10), Wrap=True)
item_5 = ListItem(List=panel_4, Index=Slider(4, range=0..10), Wrap=True)
item_6 = ListItem(List=panel_4, Index=Slider(2, range=0..10), Wrap=True)
panel_5 = Panel(item_5)
addition = Addition(A=panel_5, B="0.18")
panel_6 = Panel(item_6)
panel_7 = Panel(item_3)
number_slider = Slider(1.7, range=0..200)
panel_8 = Panel(item_2)
panel_9 = Panel(item_4)
number_slider_2 = Slider(0.36, range=0..200)
panel_10 = Panel(addition)
concat = Concatenate(FragmentA="Hora = ", FragmentB=panel_7)
concat_2 = Concatenate(FragmentA="Ta = ", FragmentB=panel_8, FragmentC=" C°")
concat_3 = Concatenate(FragmentA="Met = ", FragmentB=number_slider)
concat_4 = Concatenate(FragmentA="Clo = ", FragmentB=number_slider_2)
concat_5 = Concatenate(FragmentA="RH = ", FragmentB=panel_6, FragmentC=" %")
concat_6 = Concatenate(FragmentA="MRT = ", FragmentB=panel_9, FragmentC=" C°")
concat_7 = Concatenate(FragmentA="Vel = ", FragmentB=panel_10, FragmentC=" m/s")
psychrometricchart = LBPsychrometricChart(temperature=panel_8, rel_humidity=panel_6)  # -> report, title, temp_lines, rh_lines, hr_lines, enth_wb_lines, mesh, legend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; plug-in component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
swatch = ColourSwatch(SwatchColor=RGB(30, 30, 30))
pmv_polygon = LBPMVPolygon(
    psych_chart=psychrometricchart.psych_chart,
    mrt=panel_9,
    air_speed=panel_10,
    met_rate=number_slider,
    clothing=number_slider_2)  # -> report, total_comfort, total_comf_data, polygon_names, polygon_comfort, polygon_data, comfort_poly, strategy_poly; plug-in component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
pmv = LBPMVComfort(
    air_temp=panel_8,
    mrt=panel_9,
    rel_humid=panel_6,
    air_speed=panel_10,
    met_rate=number_slider,
    clothing=number_slider_2,
    run=Toggle(True))  # -> report, pmv, ppd, set, comfort, condition, heat_loss, comf_obj; plug-in component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
preview = CustomPreview(Geometry=psychrometricchart.temp_lines, Material=swatch)
preview_2 = CustomPreview(Geometry=psychrometricchart.rh_lines, Material=swatch)
sph = Sphere(Base=psychrometricchart.points, Radius=Slider(1500, range=0..10000))
mesh = MeshBrep(
    Brep=pmv_polygon.comfort_poly,
    Settings={GridMaxCount=0, GridMinCount=16, JaggedSeams=False, MaxEdgeLength=0, MinEdgeLength=0.0001, MinTolerance=0, Refine=True, RefineAngle=0, RelativeTolerance=0.65, SimplePlanes=True, Tolerance=0})
edges = BrepEdges(Brep=pmv_polygon.comfort_poly)  # -> Naked, Interior, NonManifold
preview_3 = CustomPreview(Geometry=psychrometricchart.hr_lines, Material=swatch)
preview_4 = CustomPreview(Geometry=mesh, Material=ColourSwatch(SwatchColor=RGB(0, 180, 0)))
preview_5 = CustomPreview(Geometry=psychrometricchart.enth_wb_lines, Material=swatch)
preview_6 = CustomPreview(Geometry=sph, Material=ColourSwatch(SwatchColor=RGB(220, 0, 0)))
preview_7 = CustomPreview(Geometry=edges.Naked, Material=ColourSwatch(SwatchColor=RGB(0, 180, 0)))
panel_11 = Panel(pmv.comfort)
panel_12 = Panel(pmv.pmv)
panel_13 = Panel(pmv.condition)
panel_14 = Panel(pmv.ppd)
concat_8 = Concatenate(FragmentA="PPD = ", FragmentB=panel_14)
concat_9 = Concatenate(FragmentA="PMV = ", FragmentB=panel_12)
merge = Merge(
    Data1=concat,
    Data2=concat_2,
    Data3=concat_5,
    Data4=concat_6,
    Data5=concat_7,
    Data6=concat_3,
    Data7=concat_4,
    Data8=concat_9,
    Data9=concat_8)
pt = ConstructPoint(
    XCoordinate=Slider(0, range=0..200),
    YCoordinate=Slider(90000, range=-10000..1000000),
    ZCoordinate=Slider(0, range=0..200))
tag = TextTag3D(
    Location=pt,
    Text=merge,
    Size=Slider(3500, range=0..10000),
    Colour=ColourSwatch(SwatchColor=RGB(30, 30, 30)),
    Justification=7)
